# Grasshopper definition gridfinity.ghx (Grasshopper 1.0.7)
# plug-ins: Human

height_multiples_of_7 = Slider(3, range=0..10)
height_multiples_of_7_2 = Slider(4, range=0..10)
fillet_radius = Panel("4")
x_count = Slider(1, range=0..10)
height_of_bottom = Slider(2, range=0..10)
y_count = Slider(5, range=0..10)

number_slider = Slider(42, range=0..100)
rectangle = Rectangle(Plane=PlaneXY(0, 0, 0), XSize=number_slider, YSize=number_slider, Radius=0)  # -> Rectangle, Length

gridfinity_base = Brep(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)
height_divider_mm = GetNumber(height_multiples_of_7, AtLeast=1, AtMost=1, Maximum=1.797693135e+308, Minimum=-1.797693135e+308, TreeAccess=False)
height_total_mm = GetNumber(height_multiples_of_7_2, AtLeast=1, AtMost=1, Maximum=1.797693135e+308, Minimum=-1.797693135e+308, TreeAccess=False)
x_divider = GetBoolean(Toggle(False), AtLeast=1, AtMost=1, FalseValue="False", TreeAccess=False, TrueValue="True")
bake = GetBoolean(Button(), AtLeast=1, AtMost=1, FalseValue="False", TreeAccess=False, TrueValue="True")
y_divider = GetBoolean(Toggle(False), AtLeast=1, AtMost=1, FalseValue="False", TreeAccess=False, TrueValue="True")
x_count_2 = GetNumber(x_count, AtLeast=1, AtMost=1, Maximum=1.797693135e+308, Minimum=-1.797693135e+308, TreeAccess=False)
y_count_2 = GetNumber(y_count, AtLeast=1, AtMost=1, Maximum=1.797693135e+308, Minimum=-1.797693135e+308, TreeAccess=False)
height_bottom_surface_mm = GetNumber(height_of_bottom, AtLeast=1, AtMost=1, Maximum=1.797693135e+308, Minimum=-1.797693135e+308, TreeAccess=False)

multiplication = Multiplication(A="7", B=height_total_mm)

division = Division(A=number_slider, B="2")
rectangle_2 = Rectangle(Plane=PlaneXY(0, 0, 0), XSize=division, YSize=division, Radius=0)  # -> Rectangle, Length

# ---- group: -1 Count
subtraction = Subtraction(A=x_count_2, B="1")
subtraction_2 = Subtraction(A=y_count_2, B="1")

# ----
y_size_count = Multiplication(A=number_slider, B=y_count_2)
x_size_count = Multiplication(A=number_slider, B=x_count_2)
rectangle_3 = Rectangle(Plane=PlaneXY(0, 0, 0), XSize=x_size_count, YSize=y_size_count, Radius=fillet_radius)  # -> Rectangle, Length

# ---- group: To bool diff from Outside Frame
multiplication_2 = Multiplication(A=x_count_2, B="2")
multiplication_3 = Multiplication(A=y_count_2, B="2")
subtraction_3 = Subtraction(A=multiplication_3, B="1")
subtraction_4 = Subtraction(A=multiplication_2, B="1")
arrrec = RectangularArray(Geometry=gridfinity_base, Cell=rectangle_2.Rectangle, XCount=subtraction_4, YCount=subtraction_3)  # -> flatten(Geometry), Transform

# ---- group: Bottom Frame
arrrec_2 = RectangularArray(Geometry=gridfinity_base, Cell=rectangle.Rectangle, XCount=x_count_2, YCount=y_count_2)  # -> flatten(Geometry), Transform

# ---- group: Outside Edge
Z = UnitZ(Factor="4.75")
move = Move(Geometry=rectangle_3.Rectangle, Motion=Z)  # -> Geometry, Transform

# ---- group: Bottom Piece Extrusion
Z_2 = UnitZ(Factor=height_bottom_surface_mm)
extr = Extrude(Base=move.Geometry, Direction=Z_2)
cap = CapHoles(Brep=extr)

# ---- group: Inside Edge - 1 Big Piece
subtraction_5 = Subtraction(A="35.6", B=number_slider)
division_2 = Division(A=subtraction_5, B="2")
offset = OffsetCurve(Curve=move.Geometry, Distance=division_2, Corners=1)

# ----
merge = Merge(Data1=move.Geometry, Data2=offset)

Z_3 = UnitZ(Factor=multiplication)
extr_2 = Extrude(Base=merge, Direction=Z_3)
cap_2 = CapHoles(Brep=extr_2)
bang = ExplodeTree(Data=cap_2)  # -> Branch0, Branch1
sdiff = SolidDifference(BrepsA=bang.Branch0, BrepsB=bang.Branch1)

Z_4 = UnitZ(Factor=multiplication)

# ---- group: Move up to Position
move_2 = Move(Geometry=arrrec.Geometry, Motion=Z_4)  # -> Geometry, Transform

# ---- group: Outside Frame
sdiff_2 = SolidDifference(BrepsA=sdiff, BrepsB=move_2.Geometry)

# ---- group: gridfinity base
brep = Brep(arrrec_2.Geometry)

# ---- group: Bottom Piece
brep_2 = Brep(cap)

# ---- group: Outside Frame
brep_3 = Brep(sdiff_2)

# ---- group: X-Divider
divider = Curve(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)
multiplication_4 = Multiplication(A="7", B=height_divider_mm)
Z_5 = UnitZ(Factor=multiplication_4)

# ----
gate = StreamGate(Stream=divider, Gate=x_divider)  # -> Target0, Target1

# ---- group: X-Divider (continued)
extr_3 = Extrude(Base=gate.Target1, Direction=Z_5)
cap_3 = CapHoles(Brep=extr_3)

# ----
arrrec_3 = RectangularArray(Geometry=cap_3, Cell=rectangle.Rectangle, XCount=x_count_2, YCount=subtraction_2)  # -> Geometry, Transform

# ---- group: X Divider
brep_4 = Brep(arrrec_3.Geometry)

# ---- group: Y-Divider
divider_2 = Curve(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)
multiplication_5 = Multiplication(A="7", B=height_divider_mm)
Z_6 = UnitZ(Factor=multiplication_5)

# ----
gate_2 = StreamGate(Stream=divider_2, Gate=y_divider)  # -> Target0, Target1

# ---- group: Y-Divider (continued)
extr_4 = Extrude(Base=gate_2.Target1, Direction=Z_6)
cap_4 = CapHoles(Brep=extr_4)

# ----
arrrec_4 = RectangularArray(Geometry=cap_4, Cell=rectangle.Rectangle, XCount=subtraction, YCount=y_count_2)  # -> Geometry, Transform

# ---- group: Y Divider
brep_5 = Brep(arrrec_4.Geometry)

# ----
merge_2 = Merge(Data1=flatten(brep), Data2=brep_2, Data3=flatten(brep_3), Data4=brep_4, Data5=brep_5)

# ---- group: RH_OUT:Breps
brep_6 = Brep(merge_2)

# ----
bake_2 = BakeGeometry(Bake=bake, Geometry=brep_6, DeleteOldBakes=False, PreserveTrees=False)
