# Grasshopper definition gridfinity_HopsDefault.gh (Grasshopper 1.0.7)
# plug-ins: Human, Hops

hops = Hops(
    XCount=Slider(4, range=0..100),
    YCount=Slider(3, range=0..100),
    HeightBottomSurfaceMm=Slider(1, range=0..100),
    HeightTotalMm=Slider(4, range=0..100),
    HeightDividerMm=Slider(3, range=0..100),
    XDivider=Toggle(True),
    YDivider=Toggle(True),
    CacheResultsInMemory=True,
    CacheSolveResults=True,
    RemoteDefinitionLocation="C:\Users\syaz\Documents\gridfinity\gridfinity-rhino3d\gridfinity.ghx",
    RemoteSolveVersion=(0, 1, 0),
    ShowInput_Enabled=False,
    ShowInput_Path=False,
    SynchronousSolve=True)
bake = BakeGeometry(Bake=Button(), Geometry=hops, DeleteOldBakes=False, PreserveTrees=False)
